# Grasshopper definition 120325_Hyper a_collab.gh (Grasshopper 1.0.8)
# plug-ins: Speckle 2, Weaverbird, DendroGH

add_speckl_url = Text("https://macad.speckle.xyz/projects/40656cdf62/models/1abbc8b816")

# ----
# Receive mass
panel = Panel("https://macad.speckle.xyz/projects/31f8cca4e0/models/f15709e666")
receive = Receive(
    Stream=panel,
    AutoReceive=False,
    CurrentComponentState="expired",
    ExpandOutput=True,
    LastInfoMessage="Seda Soylu @ 03/13/2025 10:47:19: Pushed 74 elements from Grasshopper. (id:00f01f359e)",
    ReceiveOnOpen=False,
    ReceivedCommitId="00f01f359e",
    StreamWrapper="https://macad.speckle.xyz/projects/31f8cca4e0/models/hypera/services/neighborhoods/mass",
    selectedKitName="Objects")  # -> Info, Data
deconstruct_speckle_object = DeconstructSpeckleObject(SpeckleObject=receive.Data, selectedKitName="Objects")  # -> HyperAMass, MassNodeFloors, MassUpperAndLowerParts, NeighborhoodNames

synchronous_receiver = SynchronousReceiver(
    Stream=add_speckl_url,
    AutoReceive=False,
    KitName="Objects",
    ReceivedObjectId="47e07f4cd10ba77d97af1c9ee0b04799",
    StreamWrapper="https://macad.speckle.xyz/projects/40656cdf62/models/1abbc8b816",
    selectedKitName="Objects")  # -> Data, Info
deconstruct_speckle_object_2 = DeconstructSpeckleObject(SpeckleObject=synchronous_receiver.Data, selectedKitName="Objects")  # -> Neighbourhood1, Neighbourhood2, Neighbourhood3, Neighbourhood4, Neighbourhood5, Neighbourhood6, Neighbourhood7, Neighbourhood8
mesh = Mesh(deconstruct_speckle_object_2.Neighbourhood1)
brep = Brep(deconstruct_speckle_object.HyperAMass)
volume = Volume(Geometry=brep)  # -> Volume, Centroid
scale = Scale(Geometry=brep, Center=volume.Centroid, Factor=Slider(1.1, range=0..10))  # -> Geometry, Transform
triremesh = TriRemesh(Geometry=mesh, Length=Slider(10, range=0..10), Iterations=25)  # -> Triangulation, Dual, Creases

# ----
# Fillet mesh
radius = Slider(2, range=0..30)
resolution = Slider(0.5, range=0.3..0.6)
multiplication = Multiplication(A=radius, B=resolution)
vsettings = CreateSettings(VoxelSize=multiplication, Bandwidth=1, Isovalue=0, Adaptivity="0")  # -> graft(VolumeSettings)
vmesh = MeshToVolume(Mesh=scale.Geometry, Settings=vsettings)
vunion = VolumeUnion(Volumes=vmesh)
vsmooth = SmoothVolume(Volume=vunion, Width=1, Type=Slider(1, range=0..3), Iterations=1)
mvolume = VolumeToMesh(Volume=vsmooth, VolumeSettings=vsettings)

list_item = ListItem(List=flatten(mvolume), Index=0, Wrap=True)  # -> Item, Item1, Item2, Item3, Item4, Item5, Item6, Item7
neighbourhood_3 = Mesh(list_item.Item2)
neighbourhood_6 = Mesh(list_item.Item5)
neighbourhood_8 = Mesh(list_item.Item7)
neighbourhood_1 = Mesh(list_item.Item)
neighbourhood_2 = Mesh(list_item.Item1)
neighbourhood_4 = Mesh(list_item.Item3)
neighbourhood_5 = Mesh(list_item.Item4)
neighbourhood_7 = Mesh(list_item.Item6)
panel_2 = Panel("https://macad.speckle.xyz/projects/40656cdf62/models/1abbc8b816")
create_speckle_object = CreateSpeckleObject(
    Neighbourhood1=neighbourhood_1,
    Neighbourhood2=neighbourhood_2,
    Neighbourhood3=neighbourhood_3,
    Neighbourhood4=neighbourhood_4,
    Neighbourhood5=neighbourhood_5,
    Neighbourhood6=neighbourhood_6,
    Neighbourhood7=neighbourhood_7,
    Neighbourhood8=neighbourhood_8,
    selectedKitName="Objects")

# ----
# Member Length
mesh_edges = MeshEdges(Mesh=triremesh.Triangulation)  # -> NakedEdges, InteriorEdges, NonManifoldEdges
curve = Curve([mesh_edges.NakedEdges, mesh_edges.InteriorEdges])
length = Length(Curve=curve)
bounds = Bounds(Numbers=length)
deconstruct_domain = DeconstructDomain(Domain=bounds)  # -> Start, End
multiplication_2 = Multiplication(A=deconstruct_domain.Start, B=Slider(0.796, range=0..10))
multiplication_3 = Multiplication(A=deconstruct_domain.End, B=Slider(0.252, range=0..10))
clamplength = ClampLength(Line=curve, LowerLimit=multiplication_2, UpperLimit=multiplication_3, Strength=Slider(0.084, range=0..10))

send = Send(
    Stream=panel_2,
    Data=create_speckle_object,
    AutoSend=False,
    BaseId="47e07f4cd10ba77d97af1c9ee0b04799",
    CurrentComponentState="expired",
    KitName="Objects",
    OutputWrappers="https://macad.speckle.xyz\t40656cdf62\t53cd605efb",
    UseDefaultCache=True,
    selectedKitName="Objects")
hingepoints = HingePoints(Mesh=triremesh.Triangulation)  # -> _1, _2, _3, _4
hinge = Hinge(FoldStart=hingepoints._1, FoldEnd=hingepoints._2, Tip1=hingepoints._3, Tip2=hingepoints._4, Strength=1)
show = Show(G=triremesh.Triangulation)
panel_3 = Panel("Bot Speckle Token")
add_speckl_url_2 = Text("https://macad.speckle.xyz/projects/40656cdf62/models/1abbc8b816")

panel_4 = Panel("0a7a2c01a136ad89e2cfa5e002c9f1bcbe5656a1d0")
sgetwt = StreamGetWithToken(AuthToken=add_speckl_url_2)

# ----
# Panels on Srf
bounding_box = BoundingBox(Content=triremesh.Triangulation, Plane=PlaneXY(0, 0, 0))  # -> Box, Box_2
volume_2 = Volume(Geometry=bounding_box.Box)  # -> Volume, Centroid
nakedvertices = NakedVertices(Mesh=triremesh.Triangulation)  # -> ClothedIndex, NakedIndex, ClothedPts, NakedPts
point = Point(nakedvertices.ClothedPts)

division = Division(A=Slider(1.05, range=0..10), B=100)
division_2 = Division(A=Slider(2, range=0..10), B=100)
division_3 = Division(A=Slider(50, range=0..100), B=100)

scale_nu = ScaleNU(Geometry=bounding_box.Box, Plane=volume_2.Centroid, ScaleX=division_2, ScaleY=division_2, ScaleZ=division)  # -> Geometry, Transform
solidpointcollide = SolidPointCollide(Points=point, Solid=scale_nu.Geometry, Interior=False, Unidirectional=True, Strength=division_3)

# ----
# Equal length diagonals
face_boundaries = FaceBoundaries(Mesh=triremesh.Triangulation)
explode = Explode(Curve=face_boundaries, Recursive=True)  # -> Segments, Vertices
list_item_2 = ListItem(List=explode.Segments, Index=0, Wrap=True)  # -> Item, Item1, Item2
curve_2 = Curve(list_item_2.Item2)
curve_3 = Curve([list_item_2.Item1, list_item_2.Item])

division_4 = Division(A=Slider(1, range=0..1), B=100)

equallength = EqualLength(Line=curve_3, Strength=division_4)

# ----
# Points on Srf
deconstruct_mesh = DeconstructMesh(Mesh=triremesh.Triangulation)  # -> Vertices, Faces, Colours, Normals

division_5 = Division(A=Slider(8, range=0..10), B=100)

onmesh = OnMesh(Points=deconstruct_mesh.Vertices, Mesh=triremesh.Triangulation, Strength=division_5)

# ----
# Equal Angle
number_slider = Slider(2, range=0..2)
shift_list = ShiftList(List=explode.Segments, Shift=1, Wrap=True)
curve_4 = Curve(explode.Segments)

division_6 = Division(A=number_slider, B=100)

equalangle = EqualAngle(LineA=curve_4, LineB=shift_list, Strength=division_6)

entwine = Entwine(Branch00=show, Branch01=[clamplength, onmesh, equallength, equalangle, solidpointcollide, hinge], FlattenInputs=True)
zombiesolver = ZombieSolver(
    GoalObjects=flatten(entwine),
    Threshold=Slider(0.33, range=0.01..1),
    Tolerance=Slider(1000, range=100..2000),
    MaxIterations=50000)  # -> I, V, O
tree_branch = TreeBranch(Tree=simplify(zombiesolver.O), Path=Slider(0, range=0..100), MaintainPaths=True)
panel_5 = Panel(zombiesolver.O)
weaverbird_s_dual_graph = WeaverbirdsDualGraph(MeshCurves=tree_branch, DualMode=0)

# ----
# PLANAR!!!
crv = Curve(weaverbird_s_dual_graph)  # disabled
disc = Discontinuity(Curve=crv, Level=1)  # -> Points, Parameters
plfit = PlaneFit(Points=disc.Points)  # -> Plane, Deviation
project = Project(Geometry=graft(crv), Plane=plfit.Plane)  # -> Geometry, Transform

planar_hex = Curve(flatten(project.Geometry))
create_speckle_object_2 = CreateSpeckleObject(Neighbourhood1=planar_hex, selectedKitName="Objects")
# Normalize 0-1
# Normalize 0-1
# Normalize 0-1
# Normalize 0-1
# Normalize 0-1
# Location
# Normalize 0-1
# Orientation
# Deviation
# Normalize 0-1
ss = SynchronousSender(
    Data=create_speckle_object_2,
    Stream=sgetwt,
    OutputWrappers="https://macad.speckle.xyz\t27b32e7bd2\tab5404b2dc",
    UseDefaultCache=True,
    selectedKitName="Objects")
